# Dynamo graph Sample.dyn (Dynamo 2.0.1.5055)

code_block = CodeBlock { 8000; 3000; }
byData = ZeroTouchBoothGenerator.BoothGen.ZeissBoothData.ByData(lengthX=code_block.out0, lengthY=code_block.out1)
byData_2 = ZeroTouchBoothGenerator.BoothGen.FloorProperties.ByData(data=byData)
family_types = FamilyTypes(index=163)
code_block_2 = CodeBlock { Point.ByCoordinates(1,0,0); 300; 100; 100; 2040; }
byData_3 = ZeroTouchBoothGenerator.BoothGen.FlakeboardStripesProperties.ByData(floorData=byData_2, flakeboardType=family_types, flakeBoardDirection=code_block_2.out0, desiredAccrossFlakeboardDistance=code_block_2.out1, flakeboardDistanceToBounds=code_block_2.out2, flakeboardDistanceAlong=code_block_2.out3, flakeboardLength=code_block_2.out4)
createFlakeboardStripes = ZeroTouchBoothGenerator.BoothGen.FloorGenerator.CreateFlakeboardStripes(props=byData_3)
levels = Levels(index=3)
create = ZeroTouchBoothGenerator.DynamoUtils.FamilyHelper.Create(type=createFlakeboardStripes.familyTypes, level=levels, position=createFlakeboardStripes.points, rotation=createFlakeboardStripes.rotation, length=createFlakeboardStripes.lengths, width=createFlakeboardStripes.widths)
family_types_2 = FamilyTypes(index=160)
code_block_3 = CodeBlock { 100; Point.ByCoordinates(0,1,0); 2040; 200; 915; 19; }
byData_4 = ZeroTouchBoothGenerator.BoothGen.FlakeboardPlatesProperties.ByData(floorData=byData_2, flakeboardType=family_types_2, distanceToBorder=code_block_3.out0, direction=code_block_3.out1, plateLength=code_block_3.out2, minPlateLength=code_block_3.out3, plateWidth=code_block_3.out4, zOffset=code_block_3.out5)
createFlakeboardPlates = ZeroTouchBoothGenerator.BoothGen.FloorGenerator.CreateFlakeboardPlates(props=byData_4)
levels_2 = Levels(index=3)
create_2 = ZeroTouchBoothGenerator.DynamoUtils.FamilyHelper.Create(type=createFlakeboardPlates.familyTypes, level=levels_2, position=createFlakeboardPlates.points, rotation=createFlakeboardPlates.rotation, length=createFlakeboardPlates.lengths, width=createFlakeboardPlates.widths)
watch = Watch(byData_3)
family_types_3 = FamilyTypes(index=86)
family_types_4 = FamilyTypes(index=85)
code_block_4 = CodeBlock { Point.ByCoordinates(1,0,0); 400; 900; 400; 900; 2000; 5; }
byData_5 = ZeroTouchBoothGenerator.BoothGen.FloorPlateProperties.ByData(floorProps=byData_2, whitePlates=family_types_3, normalPlates=family_types_4, lineDirection=code_block_4.out0, whitePlateWidth=code_block_4.out1, whitePlateLength=code_block_4.out2, normalPlateWidth=code_block_4.out3, normalPlateLength=code_block_4.out4, distancesBetweenWhiteLines=code_block_4.out5, gapWidthToNormalPlate=code_block_4.out6)
createFloorPlates = ZeroTouchBoothGenerator.BoothGen.FloorGenerator.CreateFloorPlates(props=byData_5)
levels_3 = Levels(index=3)
create_3 = ZeroTouchBoothGenerator.DynamoUtils.FamilyHelper.Create(type=createFloorPlates.familyTypes, level=levels_3, position=createFloorPlates.points, rotation=createFloorPlates.rotation, length=createFloorPlates.lengths, width=createFloorPlates.widths)
family_types_5 = FamilyTypes(index=2)
levels_4 = Levels(index=3)
byData_6 = ZeroTouchBoothGenerator.BoothGen.FloorBorderProperties.ByData(floorProperties=byData_2, borderType=family_types_5, level=levels_4)
createBorder = ZeroTouchBoothGenerator.BoothGen.FloorGenerator.CreateBorder(props=byData_6)
byStartPointEndPoint = Line.ByStartPointEndPoint(startPoint=createBorder.p1, endPoint=createBorder.p2)
byLine = archilab.Revit.Elements.FamilyInstance.ByLine(familyType=createBorder.familytype, line=byStartPointEndPoint, level=createBorder.level)
